# Grasshopper definition cyborgTests_191023.gh (Grasshopper 1.0.7)
# Copyright: ZHA

number_slider = Slider(80, range=0..100)  # disabled
pt = Point([Point(14.79524035, 23.0826385, 0), Point(37.45484397, 31.39519465, 0), Point(35.43214172, 9.90251535, 0)])
pt_2 = Point(Point(-13.64593815, 24.04255016, 0))
list = ValueList({"Reset": 0, "Play": 1, "Pause": 2}, selected="Reset")
crv = Curve(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)  # disabled
crv_2 = Curve(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)
list_2 = ValueList({"Reset": 0, "Play": 1, "Pause": 2}, selected="Reset")
list_3 = ValueList({"Reset": 0, "Play": 1, "Pause": 2}, selected="Reset")  # disabled
crv_3 = Curve(<curve referenced from the Rhino model>)
pt_3 = Point(Point(70.66413099, 75.25599773, 0))  # disabled
list_4 = ValueList({"Reset": 0, "Play": 1, "Pause": 2}, selected="Play")
pt_4 = Point(Point(70.66413099, 75.25599773, 0))
cy = Cy(state=list, points=pt, Reference="C:\Users\taole.c\source\repos\Cyborg\CyborgGH\bin\Cyborg.dll")  # -> out, result; inputs state: Int32, points: list of Point3d; disabled
# ---------- cy: C# usings ----------
using System.Linq;

using Cyborg.Core;
using Cyborg.Dynamics;
# ---------- cy: C# ----------
    if (state == 0)
    {
      isReset = true;
      return;
    }

    if (isReset)
    {
      pts = new List<Particle>();
      springs = new List<Spring>();

      foreach (var p in points)
      {
        pts.Add(new Particle((Vector3d) p));
      }

      for (int i = 0; i < pts.Count; i++)
      {
        for (int j = i; j < pts.Count; j++)
        {
          if (i != j)
          {
            var dist = (pts[j].pos - pts[i].pos).Length;
            springs.Add(new Spring(i, j, dist * 0.9, 0.5));
          }
        }
      }

      isReset = false;
    }


    foreach (var s in springs)
    {
      s.Calculate(pts);
      s.Apply(pts);
    }

    foreach (var p in pts)
    {
      p.Update();
    }



    result = pts.Select(p => p.pos);


    if (state == 1)
    {
      Component.ExpireSolution(true);
    }
# ---------- cy: C# additional code ----------
  List<Particle> pts;
  List<Spring> springs;

  bool isReset;



  public class Particle
  {
    public Vector3d pos, vel, accel;

    public Particle(){}

    public Particle(Vector3d pos)
    {
      this.pos = pos;
      vel = Vector3d.Zero;
      accel = Vector3d.Zero;
    }

    public void AddDelta(Vector3d delta)
    {
      accel += delta;
    }

    public void Update()
    {
      vel += accel;
      Limit(0.1);
      pos += vel;
      Clear();
    }

    private void Clear()
    {
      accel = Vector3d.Zero;
    }

    private void Limit(double maxSpeed)
    {
      if (vel.Length > maxSpeed)
      {
        vel.Unitize();
        vel *= maxSpeed;
      }
    }

  }
  public class Spring
  {
    public Vector3d delta;
    public double springConstant;
    public double targetLength;
    public int i0, i1;



    public Spring(int i0, int i1, double targetLength, double springConstant)
    {
      this.i0 = i0;
      this.i1 = i1;
      this.targetLength = targetLength;
      this.springConstant = springConstant;

    }

    public void Calculate(List<Particle> particles)
    {

      var p0 = particles[i0];
      var p1 = particles[i1];

      Vector3d vec = p1.pos - p0.pos; //vector between particles
      double deltaLength = vec.Length - targetLength;

      var unit = new Vector3d(vec);
      unit.Unitize();
      //f = -k * deltaX
      delta = (1 * springConstant * deltaLength) * unit;

    }
    public void Apply(List<Particle> particles)
    {
      particles[i0].AddDelta(delta);
      particles[i1].AddDelta(delta * -1);
    }
  }
# ---------- end cy ----------
divide = DivideCurve(Curve=crv, Count=number_slider, Kinks=False)  # -> Points, Tangents, Parameters; disabled
divide_2 = DivideCurve(Curve=crv_3, Count=Slider(200, range=0..1000), Kinks=False)  # -> Points, Tangents, Parameters
tc = TCSharp(state=list_2, point=pt_2, Reference="C:\Users\taole.c\source\repos\Cyborg\CyborgGH\bin\Cyborg.dll")  # -> out, result; inputs state: Int32, point: Point3d; disabled
# ---------- tc: C# usings ----------
using System.Linq;

using Cyborg.Core;
using Cyborg.Dynamics;
using Cyborg.Dynamics.Forces;
using Cyborg.Dynamics.Constraints;
using Cyborg.Dynamics.Interfaces;

using Particle = Cyborg.Dynamics.Particle;
# ---------- tc: C# ----------
    if (state == 0)
    {
      solver = null;
      isReset = true;
      return;
    }

    if (isReset)
    {
      counter = 0;
      
      pts = new List<Particle>();
      constraints = new List<IConstraint>();
      
      settings = new SolverSettings();
      solver = new Solver(settings);
      
      pts.Add(new Particle(new Vec3(point.X, point.Y, point.Z)));
      constraints.Add(new Linear(0, new Vec3(0.1, 0, 0)));

      isReset = false;

    }

    solver.Step(pts, constraints);

    Print(counter++.ToString());
    result = new Point3d(pts[0].Pos.X, pts[0].Pos.Y, pts[0].Pos.Z);

    if (state == 1)Component.ExpireSolution(true);

    
    /*
    //reset
    if(simState == 0)
    {
    Reset();
    return;
    }

    // setup
    if(IsReset)
    {
    Init((IEnumerable<Body>) bodies);
    }

    // update constraints & settings
    var consts = (IConstraint[]) constraints;
    _solver.Settings = (ConstraintSolverSettings) settings;

    // step solver
    for(int i = 0; i < subSteps; i++)
    _solver.Step(_bodies, consts, parallel);

    // output
    Print(String.Format("Step {0}", _solver.StepCount));

    if(_solver.IsConverged)
    Print("Converged!");
    else
    Print("Solving...");

    //result = new GH_ObjectWrapper(_bodies.Select(b => b.Position.Current));
    result = new GH_ObjectWrapper(_bodies);

    // expire solution
    if(simState == 1)
    Component.ExpireSolution(true);

    */
# ---------- tc: C# additional code ----------
  bool isReset = false;
  int counter;
  SolverSettings settings;
  Solver solver;

  List<Particle> pts;
  List<IConstraint> constraints;

  private void Reset()
  {
    solver = null;
  }
# ---------- end tc ----------
tc_2 = TCSharp(state=list_2, points=pt, Reference="C:\Users\taole.c\source\repos\Cyborg\CyborgGH\bin\Cyborg.dll")  # -> out, result; inputs state: Int32, points: list of Vector3d; disabled
# ---------- tc_2: C# ----------
    if (state == 0)
    {
      solver = null;
      isReset = true;
      return;
    }

    if (isReset)
    {
      counter = 0;

      pts = new List<Particle>();
      constraints = new List<IConstraint>();

      settings = new SolverSettings(0.01, 0.5);
      solver = new Solver(settings);

      //create particles
      foreach (var p in points)
      {
        pts.Add(new Particle(new Vec3(p.X, p.Y, p.Z)));
      }

      //create springs
      for (int i = 0; i < pts.Count; i++)
      {
        for (int j = i; j < pts.Count; j++)
        {
          if (i != j)
          {
            var dist = (pts[j].Pos - pts[i].Pos).Length;
            constraints.Add(new Spring(i, j, dist * 0.95, 0.1));
          }
        }
      }

      //create linear force
      constraints.Add(new Linear(0, new Vec3(0.2, 0, 0), 1));

      isReset = false;
    }

    solver.Step(pts, constraints);

    Print(counter++.ToString());

    //output springs as lines
    result = constraints.Where(c => c is Spring).Select(c =>
      {
      var inds = c.Indices;
      var p1 = pts[inds.ToArray()[0]].Pos;
      var p2 = pts[inds.ToArray()[1]].Pos;
      return new Line(p1.X, p1.Y, p1.Z, p2.X, p2.Y, p2.Z);
      });


    if (state == 1)Component.ExpireSolution(true);


    /*
    //reset
    if(simState == 0)
    {
    Reset();
    return;
    }

    // setup
    if(IsReset)
    {
    Init((IEnumerable<Body>) bodies);
    }

    // update constraints & settings
    var consts = (IConstraint[]) constraints;
    _solver.Settings = (ConstraintSolverSettings) settings;

    // step solver
    for(int i = 0; i < subSteps; i++)
    _solver.Step(_bodies, consts, parallel);

    // output
    Print(String.Format("Step {0}", _solver.StepCount));

    if(_solver.IsConverged)
    Print("Converged!");
    else
    Print("Solving...");

    //result = new GH_ObjectWrapper(_bodies.Select(b => b.Position.Current));
    result = new GH_ObjectWrapper(_bodies);

    // expire solution
    if(simState == 1)
    Component.ExpireSolution(true);

    */
# ---------- tc_2: C# additional code ----------
  bool isReset = false;
  int counter;
  SolverSettings settings;
  Solver solver;

  List<Particle> pts;
  List<IConstraint> constraints;

  public void Reset()
  {

  }
# ---------- end tc_2 ----------
tc_3 = TCSharp(
    state=list_3,
    points=divide.Points,
    attractors=pt_3,
    Reference="C:\Users\taole.c\source\repos\Cyborg\CyborgGH\bin\Cyborg.dll")  # -> out, result, radius, springsOut; inputs state: Int32, points: list of Vector3d, attractors: Vector3d; disabled
# ---------- tc_3: C# ----------
    var att = new Vec3(attractors.X, attractors.Y, attractors.Z);
    double cutoff = 35;
    double splitThres = 4;
    double springConstant = 0.5;
    double collStrength = 1;
    double collHardness = 1;

    if (state == 0)
    {
      solver = null;
      isReset = true;
      return;
    }

    if (isReset)
    {
      counter = 0;

      pts = new List<Particle>();
      constraints = new List<IConstraint>();

      settings = new SolverSettings(0.5, 0.2);
      solver = new Solver(settings);

      //create particles
      foreach (var p in points)
      {
        pts.Add(new Particle(new Vec3(p.X, p.Y, p.Z), 0.5));
      }

      //create springs
      for (int i = 1; i < pts.Count; i++)
      {
        var dist = (pts[i].Pos - pts[i - 1].Pos).Length;
        constraints.Add(new Spring(i - 1, i, dist * 0.95, springConstant));

        if ( i == pts.Count - 1)
        {
          var dist2 = (pts[i].Pos - pts[0].Pos).Length;
          constraints.Add(new Spring(i, 0, dist2 * 0.95, springConstant));
        }
      }

      //create collision object
      for(int i = 0; i < pts.Count; i++)constraints.Add(new Collision(i, collStrength, collHardness));

      //create linear force
      //constraints.Add(new Linear(0, new Vec3(1, 0, 0), 1));

      isReset = false;
    }

    //foreach(var p in pts) p.Radius += 0.001;

    Print(pts[0].Radius.ToString());
    Print(counter++.ToString());

    //growth

    foreach (var c in constraints)
    {
      if (c is Spring)
      {
        var indices = c.Indices.ToArray();

        var center = (pts[indices[1]].Pos + pts[indices[0]].Pos) * 0.5;
        var dist = (att - center).Length;

        if (dist < cutoff)
        {
          var growthRate = Cyborg.Util.Map(dist, 0, cutoff, 1, 0);

          Spring sp = (Spring) c;
          sp.TargetLength += 0.01 * growthRate;

        }
      }
    }
    //adjust particle Radius to edge length
    for (int i = 0; i < pts.Count; i++)
    {
      var springs = constraints.Where(c => c is Spring && c.Indices.ToList().Contains(i)).Select(c => c as Spring);
      var length = springs.Select(sp => sp.TargetLength).OrderBy(d => d).ToArray();
      pts[i].Radius = (length[0] / 2) * 0.95;

    }

    //split

    var sss = constraints.Where(c => c is Spring).Select(c => c as Spring).ToList();


    //var newConstraints
    for (int i = 0; i < sss.Count; i++)
    {
      var s = sss[i];
      if (s.TargetLength > splitThres)
      {
        //TODO instead of list count, implement check free indices
        int ind = pts.Count;
        var inds = s.Indices.ToList();
        var p0 = pts[inds[0]];
        var p1 = pts[inds[1]];

        var center = (p0.Pos + p1.Pos) * 0.5;
        pts.Add(new Particle(center, splitThres / 2 * 0.9));
        p0.Radius = splitThres / 2;
        p1.Radius = splitThres / 2;
        constraints.Add(new Collision(ind, collStrength, collHardness));
        constraints.Remove(s);
        constraints.Add(new Spring(inds[0], ind, splitThres / 2, springConstant));
        constraints.Add(new Spring(inds[1], ind, splitThres / 2, springConstant));


      }
    }

    solver.Step(pts, constraints);


    //output
    result = pts.Select(p => new Vector3d(p.Pos.X, p.Pos.Y, p.Pos.Z));
    radius = pts.Select(p => p.Radius);

    //output springs as lines
    springsOut = constraints.Where(c => c is Spring).Select(c =>
      {
      var inds = c.Indices;
      var p1 = pts[inds.ToArray()[0]].Pos;
      var p2 = pts[inds.ToArray()[1]].Pos;
      return new Line(p1.X, p1.Y, p1.Z, p2.X, p2.Y, p2.Z);
      });

    if (state == 1)Component.ExpireSolution(true);
# ---------- tc_3: C# additional code ----------
  bool isReset = false;
  int counter;
  SolverSettings settings;
  Solver solver;

  List<Particle> pts;
  List<IConstraint> constraints;


  public class DistanceField
  {

    private List<FieldObject> _objects;


    public DistanceField()
    {}



    public double ValueAt(Vec3 point)
    {

      double sum = 0d;

      foreach (var o in _objects)
      {

      }

      return 0;
    }

  }

  public class FieldObject
  {

    private Vec3 _pos;
    private double _weight;


    public Vec3 Pos
    {
      get {return _pos;}
      set {_pos = value;}
    }

    public FieldObject()
    {

    }

  }
# ---------- end tc_3 ----------

# ---- group: noSprings
tc_4 = TCSharp(
    state=list_4,
    points=divide_2.Points,
    attractors=pt_4,
    Reference="C:\Users\taole.c\source\repos\Cyborg\CyborgGH\bin\Cyborg.dll")  # -> out, result, radius, springsOut; inputs state: Int32, points: list of Vector3d, attractors: Vector3d
# ---------- tc_4: C# ----------
    var att = new Vec3(attractors.X, attractors.Y, attractors.Z);
    double cutoff = 35;
    double splitThres = (points[0] - points[1]).Length * 2;
    double springConstant = 0.1;
    double collStrength = 0.01;
    double collHardness = 1;

    if (state == 0)
    {
      solver = null;
      isReset = true;
      return;
    }

    if (isReset)
    {
      counter = 0;

      pts = new List<Particle>();
      constraints = new List<IConstraint>();

      settings = new SolverSettings(0.1, 0.7);
      solver = new Solver(settings);

      //create particles
      foreach (var p in points)
      {
        pts.Add(new Particle(new Vec3(p.X, p.Y, p.Z), 0.5));
      }

      //create springs
      for (int i = 1; i < pts.Count; i++)
      {
        var dist = (pts[i].Pos - pts[i - 1].Pos).Length;
        constraints.Add(new Spring(i - 1, i, dist * 0.95, springConstant));

        if ( i == pts.Count - 1)
        {
          var dist2 = (pts[i].Pos - pts[0].Pos).Length;
          constraints.Add(new Spring(i, 0, dist2 * 0.95, springConstant));
        }
      }

      //create collision object
      for(int i = 0; i < pts.Count; i++)constraints.Add(new CollisionSimple(i, collStrength, collHardness));

      isReset = false;
    }

    //foreach(var p in pts) p.Radius += 0.001;

    Print(pts[0].Radius.ToString());
    Print(counter++.ToString());

    //growth

    foreach (var c in constraints)
    {
      if (c is Spring)
      {
        var indices = c.Indices.ToArray();

        var center = (pts[indices[1]].Pos + pts[indices[0]].Pos) * 0.5;
        var dist = (att - center).Length;

        if (dist < cutoff)
        {
          var growthRate = Cyborg.Util.Map(dist, 0, cutoff, 1, 0);

          Spring sp = (Spring) c;
          sp.TargetLength += 0.005 * growthRate;

        }
      }
    }
    //adjust particle Radius to edge length
    for (int i = 0; i < pts.Count; i++)
    {
      var springs = constraints.Where(c => c is Spring && c.Indices.ToList().Contains(i)).Select(c => c as Spring);
      var length = springs.Select(sp => sp.TargetLength).OrderBy(d => d).ToArray();
      pts[i].Radius = (length[0] / 2) * 0.95;

    }

    //split

    var sss = constraints.Where(c => c is Spring).Select(c => c as Spring).ToList();
    for (int i = 0; i < sss.Count; i++)
    {
      var s = sss[i];
      if (s.TargetLength > splitThres)
      {
        //TODO instead of list count, implement check free indices
        int ind = pts.Count;
        var inds = s.Indices.ToList();
        var p0 = pts[inds[0]];
        var p1 = pts[inds[1]];

        var center = (p0.Pos + p1.Pos) * 0.5;
        pts.Add(new Particle(center, splitThres / 2 * 0.9));
        p0.Radius = splitThres / 2;
        p1.Radius = splitThres / 2;
        constraints.Add(new CollisionSimple(ind, collStrength, collHardness));
        constraints.Remove(s);
        constraints.Add(new Spring(inds[0], ind, splitThres / 2, springConstant));
        constraints.Add(new Spring(inds[1], ind, splitThres / 2, springConstant));
      }
    }

    solver.Step(pts, constraints);


    //output
    result = pts.Select(p => new Vector3d(p.Pos.X, p.Pos.Y, p.Pos.Z));
    radius = pts.Select(p => p.Radius);

    //output springs as lines
    springsOut = constraints.Where(c => c is Spring).Select(c =>
      {
      var inds = c.Indices;
      var p1 = pts[inds.ToArray()[0]].Pos;
      var p2 = pts[inds.ToArray()[1]].Pos;
      return new Line(p1.X, p1.Y, p1.Z, p2.X, p2.Y, p2.Z);
      });

    if (state == 1)Component.ExpireSolution(true);
# ---------- tc_4: C# additional code ----------
  bool isReset = false;
  int counter;
  SolverSettings settings;
  Solver solver;

  List<Particle> pts;
  List<IConstraint> constraints;


  public class CollisionSimple : Force, IConstraint
  {
    private int _i0;
    private Vec3 _delta;
    private double _hardness;

    public double Hardness
    {
      get { return _hardness; }
      set
      {
        if (value <= 0) throw new ArgumentOutOfRangeException("Value must be >0");
        else _hardness = value;
      }
    }

    public CollisionSimple() { }
    public CollisionSimple(int i) : this(i, 0.6)
    {
      _i0 = i;
    }
    public CollisionSimple(int i, double strength) : this(i, strength, 1.0)
    {
      _i0 = i;
      Strength = strength;
    }
    public CollisionSimple(int i, double strength, double hardness)
    {
      _i0 = i;
      _delta = new Vec3();
      Strength = strength;
      Hardness = hardness;
    }
    public void Calculate(List<Particle> particles)
    {

      var current = particles[_i0];
      int collisionCount = 0;
      Vec3 deltaSum = new Vec3();

      foreach (var p in particles)
      {
        if (p != current)
        {
          var v = p.Pos - current.Pos;
          var dist = v.Length;
          if (dist <= current.Radius + p.Radius)
          {
            collisionCount++;
            current.Pos = p.Pos + v * -1; //make sure there are no negative values for dis

            deltaSum += -1 * v.Unit * Strength;

          }
        }
      }
      if (collisionCount != 0)
        _delta = deltaSum * (1 / collisionCount);
    }

    public void Apply(List<Particle> particles)
    {
      particles[_i0].AddDelta(_delta);
    }

    public IEnumerable<int> Indices
    {
      get
      {
        yield return _i0;
      }
      set
      {
        var itr = value.GetEnumerator();

        itr.MoveNext();
        _i0 = itr.Current;
      }
    }
  }
# ---------- end tc_4 ----------

# ----
pt_5 = Point(cy.result)  # disabled
pt_6 = Point(tc.result)  # disabled
line = Line(tc_2.result)
geo = Geometry(tc_3.springsOut)  # disabled
pt_7 = Point(tc_3.result)  # disabled
geo_2 = Geometry(tc_4.springsOut)
pt_8 = Point(tc_4.result)
panel = Panel(tc_3.out)  # disabled
panel_2 = Panel(tc_4.out)
panel_3 = Panel(pt_5)
join = JoinCurves(Curves=geo_2, Preserve=False)
panel_4 = Panel("6")  # disabled
panel_5 = Panel("6")
cir = Circle(Plane=tc_3.result, Radius=tc_3.radius)  # disabled
cir_2 = Circle(Plane=tc_4.result, Radius=tc_4.radius)
cp = ControlPoints(Curve=join)  # -> Points, Weights, Knots
pt_9 = Point(<point referenced from the Rhino model>)
pt_10 = Point(<point referenced from the Rhino model>)
lng = ListLength(List=tc_3.result)  # disabled
lng_2 = ListLength(List=tc_4.result)
pt_11 = Point(Point(0, 0, 0))
intcrv = Interpolate(Vertices=cp.Points, Degree=3, Periodic=False, KnotStyle=1)  # -> Curve, Length, Domain
cy_2 = Cy(pa=pt_9, pb=pt_10, Reference="C:\Users\taole.c\source\repos\Cyborg\CyborgGH\bin\Cyborg.dll")  # -> out, result; inputs pa: Vector3d, pb: Vector3d; disabled
# ---------- cy_2: C# ----------
    var A = new Vec3(pa.X, pa.Y, pa.Z);
    var B = new Vec3(pb.X, pb.Y, pb.Z);

    var dot = A * B;

    var proj = (dot /A.Length) * A.Unit;
    result = new Vector3d(proj.X, proj.Y, proj.Z);
# ---------- end cy_2 ----------
ln = Line(StartPoint=pt_11, EndPoint=[pt_9, pt_10])
panel_6 = Panel(lng)  # disabled
panel_7 = Panel(lng_2)
ln_2 = Line(StartPoint=pt_11, EndPoint=cy_2.result)
