# Grasshopper definition cyborgTests_verlet_191212.gh (Grasshopper 1.0.7)
# Copyright: ZHA

pt = Point(Point(33.4379788, 42.02532175, 0))  # disabled
crv = Curve(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)
crv_2 = Curve(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)
number_slider = Slider(80, range=0..100)  # disabled
panel = Panel("500")  # disabled
number_slider_2 = Slider(400, range=0..1000)  # disabled
crv_3 = Curve(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)  # disabled
pt_2 = Point([Point(14.79524035, 23.0826385, 0), Point(37.45484397, 31.39519465, 0), Point(35.43214172, 9.90251535, 0)])  # disabled
pt_3 = Point(Point(-13.64593815, 24.04255016, 0))  # disabled
crv_4 = Curve(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)  # disabled
panel_2 = Panel("100")  # disabled
number_slider_3 = Slider(400, range=0..1000)  # disabled
list = ValueList({"Reset": 0, "Play": 1, "Pause": 2}, selected="Reset")  # disabled
crv_5 = Curve(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)  # disabled
crv_6 = Curve(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)  # disabled
crv_7 = Curve(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)  # disabled
divide = DivideCurve(Curve=crv_3, Count=panel_2, Kinks=False)  # -> Points, Tangents, Parameters; disabled
crv_8 = Curve(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)  # disabled
list_2 = ValueList({"Reset": 0, "Play": 1, "Pause": 2}, selected="Reset")  # disabled
divide_2 = DivideCurve(Curve=crv_6, Count=panel, Kinks=False)  # -> Points, Tangents, Parameters; disabled
list_3 = ValueList({"Reset": 0, "Play": 1, "Pause": 2}, selected="Reset")  # disabled
crv_9 = Curve(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)  # disabled
pt_4 = Point(Point(33.4379788, 42.02532175, 0))  # disabled
pt_5 = Point(Point(70.66413099, 75.25599773, 0))  # disabled
list_4 = ValueList({"Reset": 0, "Play": 1, "Pause": 2}, selected="Reset")  # disabled
divide_3 = DivideCurve(Curve=crv_2, Count="500", Kinks=False)  # -> Points, Tangents, Parameters
pt_6 = Point(Point(33.4379788, 42.02532175, 0))
crv_10 = Curve(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)  # disabled
pt_7 = Point(Point(40.78274693, 46.85886034, 0))  # disabled
list_5 = ValueList({"Reset": 0, "Play": 1, "Pause": 2}, selected="Reset")  # disabled
rectangle = Rectangle(Plane=PlaneXY(0, 0, 0), XSize="0 to 140", YSize="0 to 140", Radius=0)  # -> Rectangle, Length
pt_8 = Point(divide_2.Points)  # disabled
number_slider_4 = Slider(18, range=0..100)  # disabled
cy = Cy(state=list, points=pt_2, Reference="C:\Users\taole.c\source\repos\Cyborg\CyborgGH\bin\Cyborg.dll")  # -> out, result; inputs state: Int32, points: list of Point3d; disabled
# ---------- cy: C# usings ----------
using System.Linq;

using Cyborg.Core;
using Cyborg.Dynamics;
# ---------- cy: C# ----------
    if (state == 0)
    {
      isReset = true;
      return;
    }

    if (isReset)
    {
      pts = new List<Particle>();
      springs = new List<Spring>();

      foreach (var p in points)
      {
        pts.Add(new Particle((Vector3d) p));
      }

      for (int i = 0; i < pts.Count; i++)
      {
        for (int j = i; j < pts.Count; j++)
        {
          if (i != j)
          {
            var dist = (pts[j].pos - pts[i].pos).Length;
            springs.Add(new Spring(i, j, dist * 0.9, 0.5));
          }
        }
      }

      isReset = false;
    }


    foreach (var s in springs)
    {
      s.Calculate(pts);
      s.Apply(pts);
    }

    foreach (var p in pts)
    {
      p.Update();
    }



    result = pts.Select(p => p.pos);


    if (state == 1)
    {
      Component.ExpireSolution(true);
    }
# ---------- cy: C# additional code ----------
  List<Particle> pts;
  List<Spring> springs;

  bool isReset;



  public class Particle
  {
    public Vector3d pos, vel, accel;

    public Particle(){}

    public Particle(Vector3d pos)
    {
      this.pos = pos;
      vel = Vector3d.Zero;
      accel = Vector3d.Zero;
    }

    public void AddDelta(Vector3d delta)
    {
      accel += delta;
    }

    public void Update()
    {
      vel += accel;
      Limit(0.1);
      pos += vel;
      Clear();
    }

    private void Clear()
    {
      accel = Vector3d.Zero;
    }

    private void Limit(double maxSpeed)
    {
      if (vel.Length > maxSpeed)
      {
        vel.Unitize();
        vel *= maxSpeed;
      }
    }

  }
  public class Spring
  {
    public Vector3d delta;
    public double springConstant;
    public double targetLength;
    public int i0, i1;



    public Spring(int i0, int i1, double targetLength, double springConstant)
    {
      this.i0 = i0;
      this.i1 = i1;
      this.targetLength = targetLength;
      this.springConstant = springConstant;

    }

    public void Calculate(List<Particle> particles)
    {

      var p0 = particles[i0];
      var p1 = particles[i1];

      Vector3d vec = p1.pos - p0.pos; //vector between particles
      double deltaLength = vec.Length - targetLength;

      var unit = new Vector3d(vec);
      unit.Unitize();
      //f = -k * deltaX
      delta = (1 * springConstant * deltaLength) * unit;

    }
    public void Apply(List<Particle> particles)
    {
      particles[i0].AddDelta(delta);
      particles[i1].AddDelta(delta * -1);
    }
  }
# ---------- end cy ----------
pt_9 = Point(divide_3.Points)
number_slider_5 = Slider(18, range=0..100)  # disabled
divide_4 = DivideCurve(Curve=crv_5, Count=number_slider, Kinks=False)  # -> Points, Tangents, Parameters; disabled
pt_10 = Point(Point(70.44278892, 13.14612083, 0))  # disabled
pt_11 = Point(Point(55.59805605, 16.69279539, 0))  # disabled
divide_5 = DivideCurve(Curve=crv_9, Count=number_slider_2, Kinks=False)  # -> Points, Tangents, Parameters; disabled
list_6 = ValueList({"Reset": 0, "Play": 1, "Pause": 2}, selected="Reset")  # disabled
number_slider_6 = Slider(18, range=0..100)  # disabled
pt_12 = Point(divide.Points)  # disabled
divide_6 = DivideCurve(Curve=crv_10, Count=number_slider_3, Kinks=False)  # -> Points, Tangents, Parameters; disabled
list_7 = ValueList({"Reset": 0, "Play": 1, "Pause": 2}, selected="Reset")  # disabled
number_slider_7 = Slider(18, range=0..100)
list_8 = ValueList({"Reset": 0, "Play": 1, "Pause": 2}, selected="Reset")  # disabled
tc = TCSharp(state=list_2, point=pt_3, Reference="C:\Users\taole.c\source\repos\Cyborg\CyborgGH\bin\Cyborg.dll")  # -> out, result; inputs state: Int32, point: Point3d; disabled
# ---------- tc: C# usings ----------
using System.Linq;

using Cyborg.Core;
using Cyborg.Dynamics;
using Cyborg.Dynamics.Forces;
using Cyborg.Dynamics.Constraints;
using Cyborg.Dynamics.Interfaces;

using Particle = Cyborg.Dynamics.Particle;
# ---------- tc: C# ----------
    if (state == 0)
    {
      solver = null;
      isReset = true;
      return;
    }

    if (isReset)
    {
      counter = 0;
      
      pts = new List<Particle>();
      constraints = new List<IConstraint>();
      
      settings = new SolverSettings();
      solver = new Solver(settings);
      
      pts.Add(new Particle(new Vec3(point.X, point.Y, point.Z)));
      constraints.Add(new Linear(0, new Vec3(0.1, 0, 0)));

      isReset = false;

    }

    solver.Step(pts, constraints);

    Print(counter++.ToString());
    result = new Point3d(pts[0].Pos.X, pts[0].Pos.Y, pts[0].Pos.Z);

    if (state == 1)Component.ExpireSolution(true);

    
    /*
    //reset
    if(simState == 0)
    {
    Reset();
    return;
    }

    // setup
    if(IsReset)
    {
    Init((IEnumerable<Body>) bodies);
    }

    // update constraints & settings
    var consts = (IConstraint[]) constraints;
    _solver.Settings = (ConstraintSolverSettings) settings;

    // step solver
    for(int i = 0; i < subSteps; i++)
    _solver.Step(_bodies, consts, parallel);

    // output
    Print(String.Format("Step {0}", _solver.StepCount));

    if(_solver.IsConverged)
    Print("Converged!");
    else
    Print("Solving...");

    //result = new GH_ObjectWrapper(_bodies.Select(b => b.Position.Current));
    result = new GH_ObjectWrapper(_bodies);

    // expire solution
    if(simState == 1)
    Component.ExpireSolution(true);

    */
# ---------- tc: C# additional code ----------
  bool isReset = false;
  int counter;
  SolverSettings settings;
  Solver solver;

  List<Particle> pts;
  List<IConstraint> constraints;

  private void Reset()
  {
    solver = null;
  }
# ---------- end tc ----------
tc_2 = TCSharp(state=list_2, points=pt_2, Reference="C:\Users\taole.c\source\repos\Cyborg\CyborgGH\bin\Cyborg.dll")  # -> out, result; inputs state: Int32, points: list of Vector3d; disabled
# ---------- tc_2: C# ----------
    if (state == 0)
    {
      solver = null;
      isReset = true;
      return;
    }

    if (isReset)
    {
      counter = 0;

      pts = new List<Particle>();
      constraints = new List<IConstraint>();

      settings = new SolverSettings(0.01, 0.5);
      solver = new Solver(settings);

      //create particles
      foreach (var p in points)
      {
        pts.Add(new Particle(new Vec3(p.X, p.Y, p.Z)));
      }

      //create springs
      for (int i = 0; i < pts.Count; i++)
      {
        for (int j = i; j < pts.Count; j++)
        {
          if (i != j)
          {
            var dist = (pts[j].Pos - pts[i].Pos).Length;
            constraints.Add(new Spring(i, j, dist * 0.95, 0.1));
          }
        }
      }

      //create linear force
      constraints.Add(new Linear(0, new Vec3(0.2, 0, 0), 1));

      isReset = false;
    }

    solver.Step(pts, constraints);

    Print(counter++.ToString());

    //output springs as lines
    result = constraints.Where(c => c is Spring).Select(c =>
      {
      var inds = c.Indices;
      var p1 = pts[inds.ToArray()[0]].Pos;
      var p2 = pts[inds.ToArray()[1]].Pos;
      return new Line(p1.X, p1.Y, p1.Z, p2.X, p2.Y, p2.Z);
      });


    if (state == 1)Component.ExpireSolution(true);


    /*
    //reset
    if(simState == 0)
    {
    Reset();
    return;
    }

    // setup
    if(IsReset)
    {
    Init((IEnumerable<Body>) bodies);
    }

    // update constraints & settings
    var consts = (IConstraint[]) constraints;
    _solver.Settings = (ConstraintSolverSettings) settings;

    // step solver
    for(int i = 0; i < subSteps; i++)
    _solver.Step(_bodies, consts, parallel);

    // output
    Print(String.Format("Step {0}", _solver.StepCount));

    if(_solver.IsConverged)
    Print("Converged!");
    else
    Print("Solving...");

    //result = new GH_ObjectWrapper(_bodies.Select(b => b.Position.Current));
    result = new GH_ObjectWrapper(_bodies);

    // expire solution
    if(simState == 1)
    Component.ExpireSolution(true);

    */
# ---------- tc_2: C# additional code ----------
  bool isReset = false;
  int counter;
  SolverSettings settings;
  Solver solver;

  List<Particle> pts;
  List<IConstraint> constraints;

  public void Reset()
  {

  }
# ---------- end tc_2 ----------
list_9 = ValueList({"Reset": 0, "Play": 1, "Pause": 2}, selected="Reset")
tc_3 = TCSharp(
    state=list_3,
    points=divide_4.Points,
    attractors=pt_5,
    Reference="C:\Users\taole.c\source\repos\Cyborg\CyborgGH\bin\Cyborg.dll")  # -> out, result, radius, springsOut; inputs state: Int32, points: list of Vector3d, attractors: Vector3d; disabled
# ---------- tc_3: C# ----------
    var att = new Vec3(attractors.X, attractors.Y, attractors.Z);
    double cutoff = 35;
    double splitThres = 4;
    double springConstant = 0.5;
    double collStrength = 1;
    double collHardness = 1;

    if (state == 0)
    {
      solver = null;
      isReset = true;
      return;
    }

    if (isReset)
    {
      counter = 0;

      pts = new List<Particle>();
      constraints = new List<IConstraint>();

      settings = new SolverSettings(0.5, 0.2);
      solver = new Solver(settings);

      //create particles
      foreach (var p in points)
      {
        pts.Add(new Particle(new Vec3(p.X, p.Y, p.Z), 0.5));
      }

      //create springs
      for (int i = 1; i < pts.Count; i++)
      {
        var dist = (pts[i].Pos - pts[i - 1].Pos).Length;
        constraints.Add(new Spring(i - 1, i, dist * 0.95, springConstant));

        if ( i == pts.Count - 1)
        {
          var dist2 = (pts[i].Pos - pts[0].Pos).Length;
          constraints.Add(new Spring(i, 0, dist2 * 0.95, springConstant));
        }
      }

      //create collision object
      for(int i = 0; i < pts.Count; i++)constraints.Add(new Collision(i, collStrength, collHardness));

      //create linear force
      //constraints.Add(new Linear(0, new Vec3(1, 0, 0), 1));

      isReset = false;
    }

    //foreach(var p in pts) p.Radius += 0.001;

    Print(pts[0].Radius.ToString());
    Print(counter++.ToString());

    //growth

    foreach (var c in constraints)
    {
      if (c is Spring)
      {
        var indices = c.Indices.ToArray();

        var center = (pts[indices[1]].Pos + pts[indices[0]].Pos) * 0.5;
        var dist = (att - center).Length;

        if (dist < cutoff)
        {
          var growthRate = Cyborg.Util.Map(dist, 0, cutoff, 1, 0);

          Spring sp = (Spring) c;
          sp.TargetLength += 0.01 * growthRate;

        }
      }
    }
    //adjust particle Radius to edge length
    for (int i = 0; i < pts.Count; i++)
    {
      var springs = constraints.Where(c => c is Spring && c.Indices.ToList().Contains(i)).Select(c => c as Spring);
      var length = springs.Select(sp => sp.TargetLength).OrderBy(d => d).ToArray();
      pts[i].Radius = (length[0] / 2) * 0.95;

    }

    //split

    var sss = constraints.Where(c => c is Spring).Select(c => c as Spring).ToList();


    //var newConstraints
    for (int i = 0; i < sss.Count; i++)
    {
      var s = sss[i];
      if (s.TargetLength > splitThres)
      {
        //TODO instead of list count, implement check free indices
        int ind = pts.Count;
        var inds = s.Indices.ToList();
        var p0 = pts[inds[0]];
        var p1 = pts[inds[1]];

        var center = (p0.Pos + p1.Pos) * 0.5;
        pts.Add(new Particle(center, splitThres / 2 * 0.9));
        p0.Radius = splitThres / 2;
        p1.Radius = splitThres / 2;
        constraints.Add(new Collision(ind, collStrength, collHardness));
        constraints.Remove(s);
        constraints.Add(new Spring(inds[0], ind, splitThres / 2, springConstant));
        constraints.Add(new Spring(inds[1], ind, splitThres / 2, springConstant));


      }
    }

    solver.Step(pts, constraints);


    //output
    result = pts.Select(p => new Vector3d(p.Pos.X, p.Pos.Y, p.Pos.Z));
    radius = pts.Select(p => p.Radius);

    //output springs as lines
    springsOut = constraints.Where(c => c is Spring).Select(c =>
      {
      var inds = c.Indices;
      var p1 = pts[inds.ToArray()[0]].Pos;
      var p2 = pts[inds.ToArray()[1]].Pos;
      return new Line(p1.X, p1.Y, p1.Z, p2.X, p2.Y, p2.Z);
      });

    if (state == 1)Component.ExpireSolution(true);
# ---------- tc_3: C# additional code ----------
  bool isReset = false;
  int counter;
  SolverSettings settings;
  Solver solver;

  List<Particle> pts;
  List<IConstraint> constraints;


  public class DistanceField
  {

    private List<FieldObject> _objects;


    public DistanceField()
    {}



    public double ValueAt(Vec3 point)
    {

      double sum = 0d;

      foreach (var o in _objects)
      {

      }

      return 0;
    }

  }

  public class FieldObject
  {

    private Vec3 _pos;
    private double _weight;


    public Vec3 Pos
    {
      get {return _pos;}
      set {_pos = value;}
    }

    public FieldObject()
    {

    }

  }
# ---------- end tc_3 ----------
list_10 = ValueList({"Reset": 0, "Play": 1, "Pause": 2}, selected="Reset")

# ---- group: noSprings
tc_4 = TCSharp(
    state=list_4,
    points=divide_5.Points,
    attractors=pt,
    Reference="C:\Users\taole.c\source\repos\Cyborg\CyborgGH\bin\Cyborg.dll")  # -> out, result, radius, springsOut; inputs state: Int32, points: list of Vector3d, attractors: Vector3d; disabled
# ---------- tc_4: C# ----------
    var att = new Vec3(attractors.X, attractors.Y, attractors.Z);
    double cutoff = 35;
    double splitThres = (points[0] - points[1]).Length * 3;
    double springConstant = 0.2;
    double collStrength = 0.8;
    double collHardness = 1;

    if (state == 0)
    {
      solver = null;
      isReset = true;
      return;
    }

    if (isReset)
    {
      counter = 0;

      pts = new List<Particle>();
      constraints = new List<IConstraint>();

      settings = new SolverSettings(0.2, 0.02);
      solver = new Solver(settings);

      //create particles
      for (int i = 0; i < points.Count; i++)
      {
        pts.Add(new Particle(i, new Vec3(points[i].X, points[i].Y, points[i].Z), 0.3));
      }

      //create springs
      for (int i = 1; i < pts.Count; i++)
      {
        var dist = (pts[i].Pos - pts[i - 1].Pos).Length;
        constraints.Add(new Spring(i - 1, i, dist * 0.95, springConstant));

        if ( i == pts.Count - 1)
        {
          var dist2 = (pts[i].Pos - pts[0].Pos).Length;
          constraints.Add(new Spring(i, 0, dist2 * 0.95, springConstant));
        }
      }

      //create collision object
      for(int i = 0; i < pts.Count; i++)constraints.Add(new CollisionSimple(i, collStrength, collHardness));

      //for (int i = 0; i < pts.Count; i++)constraints.Add(new Drag(i, 0.01));

      isReset = false;
    }

    //foreach(var p in pts) p.Radius += 0.001;

    Print(pts[0].Radius.ToString());
    Print(counter++.ToString());

    //growth

    foreach (var c in constraints)
    {
      if (c is Spring)
      {
        var indices = c.Indices.ToArray();

        var center = (pts[indices[1]].Pos + pts[indices[0]].Pos) * 0.5;
        var dist = (att - center).Length;

        if (dist < cutoff)
        {
          var growthRate = Cyborg.Util.Map(dist, 0, cutoff, 1, 0);

          Spring sp = (Spring) c;
          sp.TargetLength += 0.005 * growthRate;

        }
      }
    }
    //adjust particle Radius to edge length
    for (int i = 0; i < pts.Count; i++)
    {
      var springs = constraints.Where(c => c is Spring && c.Indices.ToList().Contains(i)).Select(c => c as Spring);
      var length = springs.Select(sp => sp.TargetLength).OrderBy(d => d).ToArray();
      pts[i].Radius = (length[0] / 2) * 0.95;

    }

    //split

    var sss = constraints.Where(c => c is Spring).Select(c => c as Spring).ToList();
    for (int i = 0; i < sss.Count; i++)
    {
      var s = sss[i];
      if (s.TargetLength > splitThres)
      {
        //TODO instead of list count, implement check free indices
        int ind = pts.Count;
        var inds = s.Indices.ToList();
        var p0 = pts[inds[0]];
        var p1 = pts[inds[1]];

        var center = (p0.Pos + p1.Pos) * 0.5;
        pts.Add(new Particle(pts.Count, center, splitThres / 2 * 0.9));
        p0.Radius = splitThres / 2;
        p1.Radius = splitThres / 2;
        constraints.Add(new CollisionSimple(ind, collStrength, collHardness));
        constraints.Remove(s);
        constraints.Add(new Spring(inds[0], ind, splitThres / 2, springConstant));
        constraints.Add(new Spring(inds[1], ind, splitThres / 2, springConstant));
      }
    }

    solver.Step(pts, constraints);


    //output
    result = pts.Select(p => new Vector3d(p.Pos.X, p.Pos.Y, p.Pos.Z));
    radius = pts.Select(p => p.Radius);

    //output springs as lines
    springsOut = constraints.Where(c => c is Spring).Select(c =>
      {
      var inds = c.Indices;
      var p1 = pts[inds.ToArray()[0]].Pos;
      var p2 = pts[inds.ToArray()[1]].Pos;
      return new Line(p1.X, p1.Y, p1.Z, p2.X, p2.Y, p2.Z);
      });

    if (state == 1)Component.ExpireSolution(true);
# ---------- tc_4: C# additional code ----------
  bool isReset = false;
  int counter;
  SolverSettings settings;
  Solver solver;

  List<Particle> pts;
  List<IConstraint> constraints;

/*
  public class CollisionSimple : Force, IConstraint
  {
    private int _i0;
    private Vec3 _delta;
    private double _hardness;

    public double Hardness
    {
      get { return _hardness; }
      set
      {
        if (value <= 0) throw new ArgumentOutOfRangeException("Value must be >0");
        else _hardness = value;
      }
    }


    public CollisionSimple() { }
    public CollisionSimple(int i) : this(i, 0.6)
    {
      _i0 = i;
    }
    public CollisionSimple(int i, double strength) : this(i, strength, 1.0)
    {
      _i0 = i;
      Strength = strength;
    }
    public CollisionSimple(int i, double strength, double hardness)
    {
      _i0 = i;
      _delta = new Vec3();
      Strength = strength;
      Hardness = hardness;
    }
    public void Calculate(List<Particle> particles)
    {

      var current = particles[_i0];
      int collisionCount = 0;
      Vec3 deltaSum = new Vec3();

      foreach (var p in particles)
      {
        if (p != current)
        {
          var v = p.Pos - current.Pos;
          var dist = v.Length;
          if (dist <= current.Radius + p.Radius)
          {
            collisionCount++;
            //current.Pos = p.Pos + v * -1; //make sure there are no negative values for dis

            deltaSum += -1 * v.Unit * Strength;

          }
        }
      }
      if (collisionCount != 0)
        _delta = deltaSum * (1 / collisionCount);
    }

    public void Apply(List<Particle> particles)
    {
      particles[_i0].AddDelta(_delta);
    }

    public IEnumerable<int> Indices
    {
      get
      {
        yield return _i0;
      }
      set
      {
        var itr = value.GetEnumerator();

        itr.MoveNext();
        _i0 = itr.Current;
      }
    }

  }

  */
# ---------- end tc_4 ----------

# ----
pop2d = Populate2D(Region=rectangle.Rectangle, Count=Slider(100, range=0..5000), Seed=1)

# ---- group: Euler noSprings
tc_5 = TCSharp(
    state=list_5,
    points=divide_6.Points,
    attractors=pt_7,
    Reference="C:\Users\taole.c\source\repos\Cyborg\CyborgGH\bin\Cyborg.dll")  # -> out, result, radius, springsOut; inputs state: Int32, points: list of Vector3d, attractors: Vector3d; disabled
# ---------- tc_5: C# ----------
    var att = new Vec3(attractors.X, attractors.Y, attractors.Z);
    double cutoff = 35;
    double splitThres = (points[0] - points[1]).Length * 2;
    double springConstant = 0.1;
    double collStrength = 0.1;
    double collHardness = 0.1;

    if (state == 0)
    {
      solver = null;
      isReset = true;
      return;
    }

    if (isReset)
    {
      counter = 0;

      pts = new List<Particle>();
      constraints = new List<IConstraint>();

      settings = new SolverSettings(0.2, 0.01);
      solver = new Solver(settings);

      //create particles
      //foreach (var p in points) pts.Add(new Particle(i, new Vec3(p.X, p.Y, p.Z), 0.5));
      for (int i = 0; i < points.Count; i++) pts.Add(new Particle(i, new Vec3(points[i].X, points[i].Y, points[i].Z), 0.1));

      /*
      //create springs
      for (int i = 1; i < pts.Count; i++)
      {
        var dist = (pts[i].Pos - pts[i - 1].Pos).Length;
        constraints.Add(new Spring(i - 1, i, dist * 0.95, springConstant));

        if ( i == pts.Count - 1)
        {
          var dist2 = (pts[i].Pos - pts[0].Pos).Length;
          constraints.Add(new Spring(i, 0, dist2 * 0.95, springConstant));
        }
      }

 */

      //create collision object
      //for(int i = 0; i < pts.Count; i++)constraints.Add(new CollisionSimple(i, collStrength, collHardness));
      foreach(var p in pts) constraints.Add(new Collision3(p.Index, collStrength, collHardness));
      foreach(var p in pts) constraints.Add(new Drag2(p.Index, 0.1));

      isReset = false;
    }

    //Print(constraints.Where(c => c is Drag2).Select(c => c).ToList().Count.ToString());

    foreach (var c in constraints)
    {
      if (c is Drag2)
      {
        Print(c.ToString());
      }
    }

    Print(pts[0].Radius.ToString());
    Print(counter++.ToString());

    //growth

    foreach(var p in pts)
    {
      var dist = (att - p.Pos).Length;
      if (dist < cutoff)
      {
        var growthRate = Cyborg.Util.Map(dist, 0, cutoff, 1, 0);
        p.Radius += 0.001 * growthRate;
      }
    }
    /*
    foreach (var c in constraints)
    {
      if (c is Spring)
      {
        var indices = c.Indices.ToArray();

        var center = (pts[indices[1]].Pos + pts[indices[0]].Pos) * 0.5;
        var dist = (att - center).Length;

        if (dist < cutoff)
        {
          var growthRate = Cyborg.Util.Map(dist, 0, cutoff, 1, 0);

          Spring sp = (Spring) c;
          sp.TargetLength += 0.005 * growthRate;

        }
      }
    }
    //adjust particle Radius to edge length
    for (int i = 0; i < pts.Count; i++)
    {
      var springs = constraints.Where(c => c is Spring && c.Indices.ToList().Contains(i)).Select(c => c as Spring);
      var length = springs.Select(sp => sp.TargetLength).OrderBy(d => d).ToArray();
      pts[i].Radius = (length[0] / 2) * 0.95;

    }


    //split

    var sss = constraints.Where(c => c is Spring).Select(c => c as Spring).ToList();
    for (int i = 0; i < sss.Count; i++)
    {
      var s = sss[i];
      if (s.TargetLength > splitThres)
      {
        //TODO instead of list count, implement check free indices
        int ind = pts.Count;
        var inds = s.Indices.ToList();
        var p0 = pts[inds[0]];
        var p1 = pts[inds[1]];

        var center = (p0.Pos + p1.Pos) * 0.5;
        pts.Add(new Particle(center, splitThres / 2 * 0.9));
        p0.Radius = splitThres / 2;
        p1.Radius = splitThres / 2;
        constraints.Add(new CollisionSimple(ind, collStrength, collHardness));
        constraints.Remove(s);
        constraints.Add(new Spring(inds[0], ind, splitThres / 2, springConstant));
        constraints.Add(new Spring(inds[1], ind, splitThres / 2, springConstant));
      }
    }
*/
    solver.Step(pts, constraints);


    //output
    result = pts.Select(p => new Vector3d(p.Pos.X, p.Pos.Y, p.Pos.Z));
    radius = pts.Select(p => p.Radius);

    //output springs as lines
    springsOut = constraints.Where(c => c is Spring).Select(c =>
      {
      var inds = c.Indices;
      var p1 = pts[inds.ToArray()[0]].Pos;
      var p2 = pts[inds.ToArray()[1]].Pos;
      return new Line(p1.X, p1.Y, p1.Z, p2.X, p2.Y, p2.Z);
      });

    if (state == 1)Component.ExpireSolution(true);
# ---------- tc_5: C# additional code ----------
  bool isReset = false;
  int counter;
  SolverSettings settings;
  Solver solver;

  List<Particle> pts;
  List<IConstraint> constraints;


  public class Drag2 : Force, IConstraint
  {

    private int _i0;
    private Vec3 _delta;
    public string debug;


    public double DragCoefficient
    {
      get { return Strength; }
      set { Strength = value; }
    }


    public Drag2() { }

    public Drag2(int index, double dragCoefficient)
    {
      _i0 = index;
      Strength = dragCoefficient;
      _delta = Vec3.Zero;
    }

    public void Calculate(List<Particle> particles)
    {
      var p = particles[_i0];
      //F = -1 * 1r(density of liquid) * vel^2 * 1A(frontal Area) * c * vel.Unit


      if (p.Vel.Length != 0)
        _delta = ( -1 * (p.Vel.Length * p.Vel.Length) * Strength ) * p.Vel.Unit;
      else
        _delta = Vec3.Zero;


    }

    public void Apply(List<Particle> particles)
    {
      particles[_i0].AddDelta(_delta);
    }


    public override string ToString()
    {
      return String.Format("{{i: {0}, strength: {1}, delta: {2} }}", _i0, Strength, _delta);
    }

    public IEnumerable<int> Indices
    {
      get
      {
        yield return _i0;
      }
      set
      {
        var itr = value.GetEnumerator();

        itr.MoveNext();
        _i0 = itr.Current;
      }
    }
  }

  public class Collision3 : Force, IConstraint
  {
    private int _i0;
    private Vec3 _delta;
    private double _hardness;

    public double Hardness
    {
      get { return _hardness; }
      set
      {
        if (value <= 0) throw new ArgumentOutOfRangeException("Value must be >0");
        else _hardness = value;
      }
    }

    public Collision3() { }
    public Collision3(int i) : this(i, 0.6)
    {
      _i0 = i;
    }
    public Collision3(int i, double strength) : this(i, strength, 1.0)
    {
      _i0 = i;
      Strength = strength;
    }
    public Collision3(int i, double strength, double hardness)
    {
      _i0 = i;
      _delta = new Vec3();
      Strength = strength;
      Hardness = hardness;
    }
    public void Calculate(List<Particle> particles)
    {

      var current = particles[_i0];
      int collisionCount = 0;
      Vec3 deltaSum = new Vec3();

      foreach (var p in particles)
      {
        if (p != current)
        {
          var v = p.Pos - current.Pos;
          var dist = v.Length;
          if (dist <= current.Radius + p.Radius)
          {
            collisionCount++;
            //current.Pos = p.Pos + v.Unit * p.Radius * -1 * 1.01; //make sure there are no negative values for dis

            deltaSum += -1 * v.Unit * Strength;

          }
        }
      }

      if (collisionCount != 0)
        _delta = deltaSum / collisionCount;
    }

    public void Apply(List<Particle> particles)
    {
      particles[_i0].AddDelta(_delta);
    }

    public IEnumerable<int> Indices
    {
      get
      {
        yield return _i0;
      }
      set
      {
        var itr = value.GetEnumerator();

        itr.MoveNext();
        _i0 = itr.Current;
      }
    }
  }
# ---------- end tc_5 ----------

# ----
pt_13 = Point(cy.result)  # disabled
pt_14 = Point(tc.result)  # disabled

# ---- group: VerletSolver
cy_2 = Cy(
    state=list_6,
    point1=pt_11,
    point2=pt_10,
    length=number_slider_4,
    Reference="C:\Users\taole.c\source\repos\Cyborg\CyborgGH\bin\Cyborg.dll")  # -> out, result; inputs state: Int32, point1: Vector3d, point2: Vector3d, length: Double; disabled
# ---------- cy_2: C# usings ----------
using System.Linq;

using Cyborg.Core;
using Cyborg.Dynamics.Verlet;
using Cyborg.Dynamics.Verlet.Constraints;
# ---------- cy_2: C# ----------
    if (state == 0)
    {
      solver = null;
      isReset = true;
      return;
    }


    if (isReset)
    {
      particles = new List<VerletParticle>();
      constraints = new List<IVerletConstraint>();
      solver = new VerletSolver();

      particles.Add(new VerletParticle(0, new Vec3(point1.X, point1.Y, point1.Z)));
      particles.Add(new VerletParticle(1, new Vec3(point2.X, point2.Y, point2.Z)));
      foreach(var p in particles) constraints.Add(new Load(p.Index, new Vec3(0, -0.01, 0)));

      //constraints.Add(new Link(0, 1, (point1 - point2).Length * 0.99, 1));
      constraints.Add(new Spring(0, 1, (point1 - point2).Length * 0.5, 1.0));
      foreach(var p in particles) constraints.Add(new Boundary(p.Index));

      isReset = false;
    }

    solver.Step(particles, constraints);

    //foreach (var c in constraints) Print(c.ToString());
    foreach(var p in particles) Print(p.Accel.ToString());


    foreach(var c in constraints)
    {
      var s = c as Spring;
      if (s != null)
        s.TargetLength = length;
    }

    result = particles.Select(p => new Vector3d(p.Pos.X, p.Pos.Y, p.Pos.Z));


    if (state == 1) Component.ExpireSolution(true);
# ---------- cy_2: C# additional code ----------
  List<VerletParticle> particles;
  List<IVerletConstraint> constraints;
  VerletSolver solver;
  bool isReset;

  public class Boundary :IVerletConstraint
  {
    private int _i0;

    public Boundary(int i0)
    {
      _i0 = i0;
    }

    public void Calculate(List<VerletParticle> particles)
    {
      var p = particles[_i0];

      if (p.Pos.Y <= 0)
      {
        var vel = p.Pos - p.OldPos;
        p.Pos += new Vec3(0, vel.Y * -1.9, 0);
      }
    }

    public IEnumerable<int> Indices
    {
      get
      {
        yield return _i0;
      }
      set
      {
        var itr = value.GetEnumerator();

        itr.MoveNext();
        _i0 = itr.Current;
      }
    }


  }

  public class Spring : IVerletConstraint
  {
    private int _i0, _i1;
    private double _targetLength, _stiffness;

    public double TargetLength
    {
      get {return _targetLength;}
      set {_targetLength = value;}
    }
    public double Stiffness
    {
      get {return _stiffness;}
      set {_stiffness = value;}
    }

    public Spring(int i0, int i1, double targetLength, double stiffness)
    {
      _i0 = i0;
      _i1 = i1;
      TargetLength = targetLength;
      Stiffness = stiffness;

    }

    public void Calculate(List<VerletParticle> particles)
    {
      var p0 = particles[_i0];
      var p1 = particles[_i1];

      var vec = p1.Pos - p0.Pos;
      var length = vec.Length;

      var diff = (length - _targetLength) / length;

      p0.Pos += vec * (diff / 2);
      p1.Pos -= vec * (diff / 2);

    }

    public IEnumerable<int> Indices
    {
      get
      {
        yield return _i0;
        yield return _i1;
      }
      set
      {
        var itr = value.GetEnumerator();

        itr.MoveNext();
        _i0 = itr.Current;
        itr.MoveNext();
        _i1 = itr.Current;
      }
    }
  }
# ---------- end cy_2 ----------

cy_3 = Cy(state=list_7, points=pt_12, Reference="C:\Users\taole.c\source\repos\Cyborg\CyborgGH\bin\Cyborg.dll")  # -> out, result; inputs state: Int32, points: list of Vector3d, length: Double; disabled
# ---------- cy_3: C# ----------
    if (state == 0)
    {
      solver = null;
      isReset = true;
      return;
    }

    if (isReset)
    {
      particles = new List<VerletParticle>();
      constraints = new List<IVerletConstraint>();
      solver = new VerletSolver();


      for (int i = 0; i < points.Count; i++) particles.Add(new VerletParticle(i, new Vec3(points[i].X, points[i].Y, points[i].Z)));
      for (int i = 1; i < particles.Count; i++)
      {
        var p0 = particles[i - 1];
        var p1 = particles[i];
        constraints.Add(new Spring(i - 1, i, (p0.Pos - p1.Pos).Length, 0.1));
        if (i == particles.Count - 1)
        {
          constraints.Add(new Spring(i, 0, (p1.Pos - particles[0].Pos).Length, 1.0));
        }
      }

      foreach(var p in particles) constraints.Add(new Load(p.Index, new Vec3(0, -0.01, 0)));
      foreach(var p in particles) constraints.Add(new Boundary(p.Index));
      foreach(var p in particles) constraints.Add(new SphereCollision(p.Index, 2, 0.1));

      isReset = false;
    }

    solver.Step(particles, constraints);

    result = particles.Select(p => new Vector3d(p.Pos.X, p.Pos.Y, p.Pos.Z));

    if (state == 1) Component.ExpireSolution(true);
# ---------- cy_3: C# additional code ----------
  List<VerletParticle> particles;
  List<IVerletConstraint> constraints;
  VerletSolver solver;
  bool isReset;

  public class Boundary :IVerletConstraint
  {
    private int _i0;


    public Boundary(int i0)
    {
      _i0 = i0;
    }

    public void Calculate(List<VerletParticle> particles)
    {
      var p = particles[_i0];

      if (p.Pos.Y <= 0)
      {
        var vel = p.Pos - p.OldPos;
        p.Pos += new Vec3(0, vel.Y * -1.5, 0);
      }
    }

    public IEnumerable<int> Indices
    {
      get
      {
        yield return _i0;
      }
      set
      {
        var itr = value.GetEnumerator();

        itr.MoveNext();
        _i0 = itr.Current;
      }
    }
  }


  //-------------------------------------------

  public class SphereCollision : IVerletConstraint
  {

    private int _i0;
    private double _stiffness;
    private double _radius;

    public SphereCollision(int index, double radius, double stiffness)
    {
      _i0 = index;
      _radius = radius;
      _stiffness = stiffness;
    }

    public void Calculate(List<VerletParticle> particles)
    {

      var p0 = particles[_i0];

      foreach (var p in particles)
      {
        if (p != p0)
        {
          var vec = p.Pos - p0.Pos;
          var length = vec.Length;
          if (length < p.Radius + p0.Radius)
          {
            p0.Pos -= vec.Unit * (( p.Radius + p0.Radius) - length) / length * 0.5 * _stiffness;
          }
        }
      }


    }

    public IEnumerable<int> Indices
    {
      get
      {
        yield return _i0;
      }
      set
      {
        var itr = value.GetEnumerator();

        itr.MoveNext();
        _i0 = itr.Current;
      }
    }

  }
# ---------- end cy_3 ----------

# ---- group: VerletSolver_workingV0.3
cy_4 = Cy(
    state=list_8,
    points=pt_8,
    attractor=pt_4,
    Reference=["C:\Users\taole.c\source\repos\Cyborg\CyborgGH\bin\Cyborg.dll", "C:\Users\taole.c\source\repos\Cyborg\CyborgGH\bin\CyborgGH.gha"])  # -> out, result, r, o_links; inputs state: Int32, points: list of Vector3d, attractor: Point3d; disabled
# ---------- cy_4: C# usings ----------
using System.Linq;

using Cyborg.Core;
using Cyborg.GH;
using Cyborg.Dynamics.Verlet;
using Cyborg.Dynamics.Verlet.Constraints;
# ---------- cy_4: C# ----------
    if (state == 0)
    {
      solver = null;
      isReset = true;
      return;
    }
    //======================================================================
    if (isReset)
    {
      particles = new List<VerletParticle>();
      constraints = new List<IVerletConstraint>();
      solver = new VerletSolver(new VerletSolverSettings(1.0, 0.05));


      //instantiate particles
      for (int i = 0; i < points.Count; i++)
      {
        double radius = 0;
        if (i != 0 && i != points.Count - 1)
        {
          var dist0 = (points[i] - points[i - 1]).Length / 2.0;
          var dist1 = (points[i] - points[i + 1]).Length / 2.0;
          radius = (dist0 + dist1) / 2.0;
        }
        else if (i == 0)
        {

          var dist0 = (points[i] - points[points.Count - 1]).Length / 2.0;
          var dist1 = (points[i] - points[i + 1]).Length / 2.0;
          radius = (dist0 + dist1) / 2.0;
        }
        else if (i == points.Count - 1)
        {
          var dist0 = (points[i] - points[i - 1]).Length / 2.0;
          var dist1 = (points[i] - points[0]).Length / 2.0;
          radius = (dist0 + dist1) / 2.0;
        }
        particles.Add(new VerletParticle(i, new Vec3(points[i].X, points[i].Y, points[i].Z), radius * 0.9));
      }

      //add links
      for (int i = 1; i < particles.Count; i++)
      {
        var p0 = particles[i - 1];
        var p1 = particles[i];
        constraints.Add(new Link(i - 1, i, (p0.Pos - p1.Pos).Length, 0.1));
        if (i == particles.Count - 1)
        {
          constraints.Add(new Link(i, 0, (p1.Pos - particles[0].Pos).Length, 1.0));
        }
      }


      //add collision
      foreach(var p in particles) constraints.Add(new SphereCollision(p.Index, 0.01));
      //foreach (var p in particles) constraints.Add(new Drag(p.Index, 0.1));

      isReset = false;
    }
    //======================================================================


    //GROW
    double cutoff = 30;
    double max = 0.002;
    double maxLength = 1;
    Vec3 attract = Cyborg.GH.Conversion.Vec3((Vector3d) attractor);

    foreach (var p in particles)
    {

      var dist = (p.Pos - attract).Length;

      if (dist < cutoff)
      {
        var factor = Cyborg.Util.Map(dist, 0, cutoff, max, 0);
        p.Radius += factor;
      }
    }


    //SPLIT
    var newConstraints = new List<IVerletConstraint>();

    var links = constraints.Where(c => c is Link).Select(c => c as Link).ToList();

    foreach (var link in links)
    {
      var inds = link.Indices.ToArray();

      var p0 = particles[inds[0]];
      var p1 = particles[inds[1]];
      var newDist = p0.Radius + p1.Radius;

      if ((p0.Pos - p1.Pos).Length < newDist) link.TargetLength = newDist * 1.05;

      //if > max length, subdivide
      var dist = (p0.Pos - p1.Pos).Length;
      if (dist > maxLength)
      {
        int ind = particles.Count;

        //removeInds.Add(ind);
        var midPos = p0.Pos + (p1.Pos - p0.Pos) / 2;
        var newParticle = new VerletParticle(ind, midPos);
        particles.Add(newParticle);
        newConstraints.Add(new SphereCollision(ind, 0.01));

        var newRadius = (newParticle.Pos - p0.Pos).Length / 2;
        p0.Radius = newRadius;
        newParticle.Radius = newRadius;
        p1.Radius = newRadius;

        constraints.Remove(link);

        newConstraints.Add(new Link(p0.Index, ind, (midPos - p0.Pos).Length, 0.1));
        newConstraints.Add(new Link(p1.Index, ind, (midPos - p1.Pos).Length, 1));
      }
    }

    if (newConstraints.Count != 0) constraints.AddRange(newConstraints);


    //PLAY
    solver.Step(particles, constraints);

    //OUTPUT
    result = particles.Select(p => new Vector3d(p.Pos.X, p.Pos.Y, p.Pos.Z));
    r = particles.Select(p => p.Radius);
    o_links = constraints.Where(c => c is Link).Select(c =>
      {
      var l = c as Link;
      var inds = l.Indices.ToArray();
      return new Line((Point3d) Conversion.Vector3d(particles[inds[0]].Pos), (Point3d) Conversion.Vector3d(particles[inds[1]].Pos));
      });



    //REFRESH
    if (state == 1) Component.ExpireSolution(true);
# ---------- cy_4: C# additional code ----------
  List<VerletParticle> particles;
  List<IVerletConstraint> constraints;
  VerletSolver solver;
  bool isReset;

  public class Boundary :IVerletConstraint
  {
    private int _i0;

    public Boundary(int i0)
    {
      _i0 = i0;
    }

    public void Calculate(List<VerletParticle> particles)
    {
      var p = particles[_i0];

      if (p.Pos.Y <= 0)
      {
        var vel = p.Pos - p.OldPos;
        p.Pos += new Vec3(0, vel.Y * -1.5, 0);
      }
    }

    public IEnumerable<int> Indices
    {
      get
      {
        yield return _i0;
      }
      set
      {
        var itr = value.GetEnumerator();

        itr.MoveNext();
        _i0 = itr.Current;
      }
    }
  }
# ---------- end cy_4 ----------

# ----
cy_5 = Cy(
    state=list_10,
    points=pop2d,
    Reference=["C:\Users\taole.c\source\repos\Cyborg\CyborgGH\bin\Cyborg.dll", "C:\Users\taole.c\source\repos\Cyborg\CyborgGH\bin\CyborgGH.gha"])  # -> out, result, grid; inputs state: Int32, points: list of Vector3d
# ---------- cy_5: C# usings ----------
using System.Linq;

using Cyborg.Core;
using Cyborg.Dynamics;
using Cyborg.Dynamics.Verlet;
using Cyborg.Dynamics.Verlet.Constraints;
using Cyborg.GH;
# ---------- cy_5: C# ----------
    var world = new Cyborg.Core.BoundingBox(new Vec3(0, 0, -500), new Vec3 (150, 150, 500));

    if (state == 0)
    {
      solver = null;
      isReset = true;
      return;
    }
    //SETUP ===========================================================
    if (isReset)
    {
      particles = new List<VerletParticle>();
      constraints = new List<IVerletConstraint>();
      solver = new VerletSolver(new VerletSolverSettings(1.0, 0.00));

      bin = new Bin2dT(new Vec2i(20, 20), 7.6);
      units = new List<Unit2d>();

      var rand = new Random();

      //add particles with random movement
      for (int i = 0; i < points.Count; i++)
      {
        particles.Add(new VerletParticle(i, Conversion.Vec3(points[i]), 0.1));
        constraints.Add(new Load(i, new Vec3(rand.Next(-100, 100) * 0.01, rand.Next(-100, 100) * 0.01, 0)));
      }

      solver.Step(particles, constraints);
      constraints.Clear();

      foreach (var p in particles)
      {
        constraints.Add(new WorldBoundary(p.Index, world));
        var u = new Unit2d(p.Index, bin, (Vec2) p.Pos);
        units.Add(u);
      }

      isReset = false;
    }
    //===============================================================
    solver.Step(particles, constraints);

    //update units
    foreach (var u in units)
    {
      bin.Move(u, (Vec2) particles.Where(p => p.Index == u.Index).Select(p => p.Pos).Single());
    }



    //OUPUT
    result = particles.Select(p => Conversion.Vector3d(p.Pos));

    var outGrid = new List<Rectangle3d>();

    for (int x = 0; x < bin.NumCells.X; x++)
    {
      for (int y = 0; y < bin.NumCells.Y; y++)
      {
        if (bin.Cells[x, y] != null)
        {
          var origin = new Point3d(x * bin.CellSize, y * bin.CellSize, 0);
          var plane = new Rhino.Geometry.Plane(origin, Vector3d.ZAxis);
          outGrid.Add(new Rectangle3d(plane, bin.CellSize, bin.CellSize));
        }
      }
    }

    grid = outGrid;

    Component.ExpireSolution(true);
# ---------- cy_5: C# additional code ----------
  List<VerletParticle> particles;
  List<IVerletConstraint> constraints;
  VerletSolver solver;
  Bin2dT bin;
  List<Unit2d> units;

  bool isReset;

  static double tempDist = 3.0;

  public class Unit2d
  {
    private Vec2 _pos;
    private Unit2d _prev, _next; //linked list
    private List<Unit2d> _inRangeUnits;

    #region PROPERTIES
    public int Index {get; set;}
    public Vec2 Pos
    {
      get {return _pos;}
      set {_pos = value;}
    }
    public Unit2d Prev
    {
      get {return _prev;}
      set {_prev = value;}
    }
    public Unit2d Next
    {
      get{return _next;}
      set {_next = value;}
    }
    #endregion

    public Unit2d(int index, Bin2dT bin, Vec2 pos)
    {
      Index = index;

      Pos = pos;
      _prev = null;
      _next = null;

      bin.Add(this);
    }
  }

  //==============================
  public class Bin2dT
  {
    private Vec2i _numCells;
    private double _cellSize;
    private Unit2d[,] _cells;


    public Unit2d[,] Cells
    {
      get {return _cells;}
    }

    public Vec2i NumCells
    {
      get {return _numCells;}
    }
    public double CellSize
    {
      get {return _cellSize;}
    }

    /// <summary>
    ///
    /// </summary>
    public Bin2dT(Vec2i numCells, double cellSize)
    {
      _numCells = numCells;
      _cellSize = cellSize;
      _cells = new Unit2d[_numCells.X, _numCells.Y];

      InitGrid();
    }

    /// <summary>
    ///
    /// </summary>
    private void InitGrid()
    {

      for (int x = 0; x < _numCells.X; x++)
      {
        for (int y = 0; y < _numCells.Y; y++)
        {
          _cells[x, y] = null;
        }
      }
    }

    /// <summary>
    ///
    /// </summary>
    public void Add(Unit2d u)
    {

      int cellX = (int) (u.Pos.X / _cellSize);
      int cellY = (int) (u.Pos.Y / _cellSize);

      //place unit in front of list
      u.Prev = null;
      u.Next = _cells[cellX, cellY];
      _cells[cellX, cellY] = u;
      if (u.Next != null)
      {
        u.Next.Prev = u;
      }
    }

    /// <summary>
    ///
    /// </summary>
    /// <returns></returns>
    public void WalkGrid()
    {
      for (int x = 0; x < _numCells.X; x++)
      {
        for (int y = 0; y < _numCells.Y; y++)
        {
          ProcessCell(_cells[x, y]);
        }
      }
    }

    /// <summary>
    ///
    /// </summary>
    /// <param name="unit"></param>
    /// <returns></returns>
    private void ProcessCell(Unit2d unit)
    {
      while (unit != null)
      {
        Unit2d other = unit.Next;
        HandleUnit(unit, other);
        unit = unit.Next;
      }
    }

    private void HandleUnit(Unit2d unit, Unit2d other)
    {
      while (other != null)
      {
        if (unit.Pos.DistanceTo(other.Pos) < tempDist)
        {
          //do stuff
        }
        other = other.Next;
      }
    }

    /// <summary>
    ///
    /// </summary>
    public void Move(Unit2d unit, Vec2 newPos)
    {
      //see which cell it was in
      int oldCellX = (int) (unit.Pos.X / _cellSize);
      int oldCellY = (int) (unit.Pos.Y / _cellSize);

      int cellX = (int) (newPos.X / _cellSize);
      int cellY = (int) (newPos.Y / _cellSize);

      unit.Pos = newPos;

      if (oldCellX == cellX && oldCellY == cellY) return;

      if (unit.Prev != null) unit.Prev.Next = unit.Next;
      if (unit.Next != null) unit.Next.Prev = unit.Prev;

      if (_cells[oldCellX, oldCellY] == unit) _cells[oldCellX, oldCellY] = unit.Next;

      Add(unit);
    }
  }
# ---------- end cy_5 ----------
line = Line(tc_2.result)  # disabled

# ---- group: VerletSolver
cy_6 = Cy(
    state=list_9,
    points=pt_9,
    attractor=pt_6,
    Reference=["C:\Users\taole.c\source\repos\Cyborg\CyborgGH\bin\Cyborg.dll", "C:\Users\taole.c\source\repos\Cyborg\CyborgGH\bin\CyborgGH.gha"])  # -> out, result, r, o_links, bb; inputs state: Int32, points: list of Vector3d, attractor: Point3d
# ---------- cy_6: C# ----------
    var bbox = new BoundingBox(points.Select(p => Conversion.Vec3((Vector3d) p)));


    if (state == 0)
    {
      solver = null;
      isReset = true;
      return;
    }
    //======================================================================
    if (isReset)
    {
      particles = new List<VerletParticle>();
      constraints = new List<IVerletConstraint>();
      solver = new VerletSolver(new VerletSolverSettings(1.0, 0.05));

      //instantiate bin
      bin = new Bin2d<VerletParticle>(70, 70, 2);

      //instantiate particles
      for (int i = 0; i < points.Count; i++)
      {
        double radius = 0;
        if (i != 0 && i != points.Count - 1)
        {
          var dist0 = (points[i] - points[i - 1]).Length / 2.0;
          var dist1 = (points[i] - points[i + 1]).Length / 2.0;
          radius = (dist0 + dist1) / 2.0;
        }
        else if (i == 0)
        {

          var dist0 = (points[i] - points[points.Count - 1]).Length / 2.0;
          var dist1 = (points[i] - points[i + 1]).Length / 2.0;
          radius = (dist0 + dist1) / 2.0;
        }
        else if (i == points.Count - 1)
        {
          var dist0 = (points[i] - points[i - 1]).Length / 2.0;
          var dist1 = (points[i] - points[0]).Length / 2.0;
          radius = (dist0 + dist1) / 2.0;
        }
        particles.Add(new VerletParticle(i, new Vec3(points[i].X, points[i].Y, points[i].Z), radius * 0.9));
      }

      //add links
      for (int i = 1; i < particles.Count; i++)
      {
        var p0 = particles[i - 1];
        var p1 = particles[i];
        constraints.Add(new Link(i - 1, i, (p0.Pos - p1.Pos).Length, 0.1));
        if (i == particles.Count - 1)
        {
          constraints.Add(new Link(i, 0, (p1.Pos - particles[0].Pos).Length, 1.0));
        }
      }

      //add collision
      foreach(var p in particles) constraints.Add(new SphereCollision(p.Index, 0.01));
      //foreach (var p in particles) constraints.Add(new Drag(p.Index, 0.1));

      isReset = false;
    }
    //======================================================================


    //GROW
    double cutoff = 30;
    double max = 0.002;

    Vec3 attract = Cyborg.GH.Conversion.Vec3((Vector3d) attractor);

    foreach (var p in particles)
    {

      var dist = (p.Pos - attract).Length;

      if (dist < cutoff)
      {
        var factor = Cyborg.Util.Map(dist, 0, cutoff, max, 0);
        p.Radius += factor;
      }
    }


    //SPLIT

    double maxLength = 1;

    var newConstraints = new List<IVerletConstraint>();

    var links = constraints.Where(c => c is Link).Select(c => c as Link).ToList();
    foreach (var link in links)
    {
      var inds = link.Indices.ToArray();

      var p0 = particles[inds[0]];
      var p1 = particles[inds[1]];
      var newDist = p0.Radius + p1.Radius;

      if ((p0.Pos - p1.Pos).Length < newDist) link.TargetLength = newDist * 1.05;

      //if > max length, subdivide
      var dist = (p0.Pos - p1.Pos).Length;
      if (dist > maxLength)
      {
        int ind = particles.Count;

        //removeInds.Add(ind);
        var midPos = p0.Pos + (p1.Pos - p0.Pos) / 2;
        var newParticle = new VerletParticle(ind, midPos);
        particles.Add(newParticle);
        newConstraints.Add(new SphereCollision(ind, 0.01));

        var newRadius = (newParticle.Pos - p0.Pos).Length / 2;
        p0.Radius = newRadius;
        newParticle.Radius = newRadius;
        p1.Radius = newRadius;

        constraints.Remove(link);

        newConstraints.Add(new Link(p0.Index, ind, (midPos - p0.Pos).Length, 0.1));
        newConstraints.Add(new Link(p1.Index, ind, (midPos - p1.Pos).Length, 1));
      }
    }

    if (newConstraints.Count != 0) constraints.AddRange(newConstraints);


    //PLAY
    solver.Step(particles, constraints);


    //OUTPUT
    result = particles.Select(p => Conversion.Vector3d(p.Pos));
    r = particles.Select(p => p.Radius);
    o_links = constraints.Where(c => c is Link).Select(c =>
      {
      var l = c as Link;
      var inds = l.Indices.ToArray();
      return new Line((Point3d) Conversion.Vector3d(particles[inds[0]].Pos), (Point3d) Conversion.Vector3d(particles[inds[1]].Pos));
      });



    //REFRESH
    if (state == 1) Component.ExpireSolution(true);
# ---------- cy_6: C# additional code ----------
  List<VerletParticle> particles;
  List<IVerletConstraint> constraints;
  VerletSolver solver;
  Bin2d<VerletParticle> bin;
  bool isReset;


  public class BoundingBox
  {

    private Vec3 _min;
    private Vec3 _max;

    public Vec3 Min
    {
      get{ return _min;}
      set{ _min = value;}
    }
    public Vec3 Max
    {
      get{return _max;}
      set{_max = value;}
    }


    /// <summary>
    /// Get bounding box for a collection of points.
    /// </summary>
    /// <param name="points"></param>
    public BoundingBox(IEnumerable<Vec3> points)
    {
      var x = points.Select(p => p.X).ToList();
      x.Sort();
      var y = points.Select(p => p.Y).ToList();
      y.Sort();
      var z = points.Select(p => p.Z).ToList();
      z.Sort();

      Min = new Vec3(x[0], y[0], z[0]);
      Max = new Vec3(x[x.Count - 1], y[y.Count - 1], z[z.Count - 1]);
    }


  }

  public class Bin2d<T>
  {
    private int _numCellsX;
    private int _numCellsY;
    private double _cellSize;
    private T[,] _cells;

    /// <summary>
    ///
    /// </summary>
    public Bin2d(int numCellsX, int numCellsY, double cellSize)
    {
      this._numCellsX = numCellsX;
      this._numCellsY = numCellsY;
      this._cellSize = cellSize;

      InitGrid();
    }

    /// <summary>
    ///
    /// </summary>
    private void InitGrid()
    {
      for (int x = 0; x < _numCellsX; x++)
      {
        for (int y = 0; y < _numCellsY; y++)
        {
          _cells[x, y] = default(T);
        }
      }
    }
  }
# ---------- end cy_6 ----------

# ----
geo = Geometry(tc_3.springsOut)  # disabled
pt_15 = Point(tc_3.result)  # disabled
geo_2 = Geometry(tc_4.springsOut)  # disabled
pt_16 = Point(tc_4.result)  # disabled
panel_3 = Panel(tc_3.out)  # disabled
geo_3 = Geometry(tc_5.springsOut)  # disabled
pt_17 = Point(tc_5.result)  # disabled
panel_4 = Panel(pt_13)  # disabled
join = JoinCurves(Curves=geo_2, Preserve=False)  # disabled
panel_5 = Panel("6")  # disabled
panel_6 = Panel(cy_2.out)  # disabled
join_2 = JoinCurves(Curves=geo_3, Preserve=False)  # disabled
panel_8 = Panel(tc_4.out)
pt_18 = Point(cy_2.result)  # disabled
number_slider_8 = Slider(3, range=0..10)  # disabled
panel_9 = Panel(cy_3.out)  # disabled
cir = Circle(Plane=tc_3.result, Radius=tc_3.radius)  # disabled
panel_11 = Panel(tc_5.out)  # disabled
pt_19 = Point(cy_3.result)  # disabled
number_slider_9 = Slider(3, range=0..10)
cir_2 = Circle(Plane=tc_4.result, Radius=tc_4.radius)  # disabled
pt_20 = Point(cy_5.result)
geo_4 = Geometry(cy_4.o_links)  # disabled
geo_5 = Geometry(cy_5.grid)
pt_21 = Point(cy_6.bb)
cp = ControlPoints(Curve=join)  # -> Points, Weights, Knots; disabled
geo_6 = Geometry(cy_6.o_links)
panel_12 = Panel(cy_4.out)  # disabled
cp_2 = ControlPoints(Curve=join_2)  # -> Points, Weights, Knots; disabled
cir_3 = Circle(Plane=tc_5.result, Radius=tc_5.radius)  # disabled
pt_22 = Point(<point referenced from the Rhino model>)  # disabled
pt_23 = Point(<point referenced from the Rhino model>)  # disabled
lng = ListLength(List=tc_3.result)  # disabled
lng_2 = ListLength(List=tc_4.result)  # disabled
pt_24 = Point(Point(0, 0, 0))  # disabled
panel_13 = Panel(cy_5.out)
intcrv = Interpolate(Vertices=cp.Points, Degree=3, Periodic=False, KnotStyle=1)  # -> Curve, Length, Domain; disabled
intcrv_2 = Interpolate(Vertices=cp_2.Points, Degree=3, Periodic=False, KnotStyle=1)  # -> Curve, Length, Domain; disabled
msphere = MeshSphere(Base=cy_4.result, Radius=cy_4.r, UCount=number_slider_8, VCount=number_slider_8)  # disabled
lng_3 = ListLength(List=tc_5.result)  # disabled
msphere_2 = MeshSphere(Base=cy_6.result, Radius=cy_6.r, UCount=number_slider_9, VCount=number_slider_9)
cy_7 = Cy(pa=pt_22, pb=pt_23, Reference="C:\Users\taole.c\source\repos\Cyborg\CyborgGH\bin\Cyborg.dll")  # -> out, result; inputs pa: Vector3d, pb: Vector3d; disabled
# ---------- cy_7: C# ----------
    var A = new Vec3(pa.X, pa.Y, pa.Z);
    var B = new Vec3(pb.X, pb.Y, pb.Z);

    var dot = A * B;

    var proj = (dot /A.Length) * A.Unit;
    result = new Vector3d(proj.X, proj.Y, proj.Z);
# ---------- end cy_7 ----------
lng_4 = ListLength(List=msphere)  # disabled
lng_5 = ListLength(List=msphere_2)
panel_14 = Panel(tc_4.result)  # disabled
panel_15 = Panel(tc_5.result)  # disabled
panel_16 = Panel(lng_4)  # disabled
panel_17 = Panel(lng_5)
ln = Line(StartPoint=pt_24, EndPoint=[pt_22, pt_23])  # disabled
panel_18 = Panel(lng)  # disabled
ln_2 = Line(StartPoint=pt_24, EndPoint=cy_7.result)  # disabled
